# Grasshopper definition 3MF EXPORT.gh (Grasshopper 1.0.8)
# plug-ins: RhinoCodePluginGH

# ----
# V1
# This version internalises the 3MF export option to 'Move output to positive XYZ octant' to always be False.
# 
# Our preferred version at Slicelab
filename = Panel("filename123")
title = Panel("design 123")
license = Panel("MIT")
rating = Panel(" ")
copyright = Panel("Slicelab")
folderpath = Panel("C:\Users\<User Name>\Desktop")
designer = Panel("Slicelab")
description = Panel("any text or info you want to embed into the 3mf export goes here")
mesh = Mesh(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)
c_script = CSharpScript(
    mesh=mesh,
    fileName=filename,
    folderPath=folderpath,
    title=title,
    designer=designer,
    description=description,
    license=license,
    rating=rating,
    copyright=copyright,
    export=Button())  # -> out, A; inputs mesh: Mesh, fileName: String, folderPath: String, title: String, designer: String, description: String, license: String, rating: String, copyright: String, export: Boolean
# ---------- c_script: C# ----------
// Grasshopper Script Instance
#region Usings
using System;
using System.Linq;
using System.Collections;
using System.Collections.Generic;
using System.Drawing;

using Rhino;
using Rhino.Geometry;
using Rhino.DocObjects;
using Rhino.FileIO;
using System.IO;
using Rhino.Collections;

using Grasshopper;
using Grasshopper.Kernel;
using Grasshopper.Kernel.Data;
using Grasshopper.Kernel.Types;
#endregion

public class Script_Instance : GH_ScriptInstance
{
    #region Notes
    /* 
      Members:
        RhinoDoc RhinoDocument
        GH_Document GrasshopperDocument
        IGH_Component Component
        int Iteration

      Methods (Virtual & overridable):
        Print(string text)
        Print(string format, params object[] args)
        Reflect(object obj)
        Reflect(object obj, string method_name)
    */
    #endregion

    private void RunScript(
	Mesh mesh,
	string fileName,
	string folderPath,
	string title,
	string designer,
	string description,
	string license,
	string rating,
	string copyright,
	bool export,
	ref object A)
    {
        if (!export)
        {
            A = "Export not triggered.";
            return;
        }

        if (mesh == null || !mesh.IsValid)
        {
            A = "No mesh provided or mesh is invalid.";
            return;
        }

        if (string.IsNullOrWhiteSpace(folderPath) || string.IsNullOrWhiteSpace(fileName))
        {
            A = "Folder path or file name not provided.";
            return;
        }

        // Ensure the folder exists
        Directory.CreateDirectory(folderPath);

        // Ensure the file name ends with ".3mf"
        if (!fileName.EndsWith(".3mf", StringComparison.OrdinalIgnoreCase))
        {
            fileName += ".3mf";
        }

        string fullPath = Path.Combine(folderPath, fileName);

      // Prepare the options as an ArchivableDictionary
        ArchivableDictionary optionsDictionary = new ArchivableDictionary();
        optionsDictionary.Set("Title", title);
        optionsDictionary.Set("Designer", designer);
        optionsDictionary.Set("Description", description);
        optionsDictionary.Set("Copyright", copyright);
        optionsDictionary.Set("LicenseTerms", license);
        optionsDictionary.Set("Rating", rating);
        optionsDictionary.Set("MoveOutputToPositiveXYZOctant", false);
    

        // Use the dictionary with the Export method
        using (var doc = RhinoDoc.CreateHeadless(null))
        {
            doc.Objects.AddMesh(mesh); // Add mesh to temporary document
            doc.Views.Redraw();

            bool success = doc.Export(fullPath, optionsDictionary); // Use the correct Export overload
            if (success)
            {
                A = "Successfully exported 3MF file to: " + fullPath;
            }
            else
            {
                A = "Failed to export 3MF file.";
            }
        }

    }
}
# ---------- end c_script ----------

# ----
# V2
# This version gives the option 'Move output to positive XYZ octant' using a Boolean Toggle on the 'move' input.
filename_2 = Panel("filename123")
title_2 = Panel("design 123")
license_2 = Panel("MIT")
rating_2 = Panel(" ")
copyright_2 = Panel("Slicelab")
folderpath_2 = Panel("C:\Users\<User Name>\Desktop")
designer_2 = Panel("Slicelab")
description_2 = Panel("any text or info you want to embed into the 3mf export goes here")
mesh_2 = Mesh(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)
c_script_2 = CSharpScript(
    mesh=mesh_2,
    fileName=filename_2,
    folderPath=folderpath_2,
    title=title_2,
    designer=designer_2,
    description=description_2,
    license=license_2,
    rating=rating_2,
    copyright=copyright_2,
    export=Button(),
    move=Toggle(False))  # -> out, A; inputs mesh: Mesh, fileName: String, folderPath: String, title: String, designer: String, description: String, license: String, rating: String, copyright: String, export: Boolean, move: Boolean
# ---------- c_script_2: C# ----------
// Grasshopper Script Instance
#region Usings
using System;
using System.Linq;
using System.Collections;
using System.Collections.Generic;
using System.Drawing;

using Rhino;
using Rhino.Geometry;
using Rhino.DocObjects;
using Rhino.FileIO;
using System.IO;
using Rhino.Collections;

using Grasshopper;
using Grasshopper.Kernel;
using Grasshopper.Kernel.Data;
using Grasshopper.Kernel.Types;
#endregion

public class Script_Instance : GH_ScriptInstance
{
    #region Notes
    /* 
      Members:
        RhinoDoc RhinoDocument
        GH_Document GrasshopperDocument
        IGH_Component Component
        int Iteration

      Methods (Virtual & overridable):
        Print(string text)
        Print(string format, params object[] args)
        Reflect(object obj)
        Reflect(object obj, string method_name)
    */
    #endregion

    private void RunScript(
	Mesh mesh,
	string fileName,
	string folderPath,
	string title,
	string designer,
	string description,
	string license,
	string rating,
	string copyright,
	bool export,
	bool move,
	ref object A)
    {
        if (!export)
        {
            A = "Export not triggered.";
            return;
        }

        if (mesh == null || !mesh.IsValid)
        {
            A = "No mesh provided or mesh is invalid.";
            return;
        }

        if (string.IsNullOrWhiteSpace(folderPath) || string.IsNullOrWhiteSpace(fileName))
        {
            A = "Folder path or file name not provided.";
            return;
        }

        // Ensure the folder exists
        Directory.CreateDirectory(folderPath);

        // Ensure the file name ends with ".3mf"
        if (!fileName.EndsWith(".3mf", StringComparison.OrdinalIgnoreCase))
        {
            fileName += ".3mf";
        }

        string fullPath = Path.Combine(folderPath, fileName);

      // Prepare the options as an ArchivableDictionary
        ArchivableDictionary optionsDictionary = new ArchivableDictionary();
        optionsDictionary.Set("Title", title);
        optionsDictionary.Set("Designer", designer);
        optionsDictionary.Set("Description", description);
        optionsDictionary.Set("Copyright", copyright);
        optionsDictionary.Set("LicenseTerms", license);
        optionsDictionary.Set("Rating", rating);
        optionsDictionary.Set("MoveOutputToPositiveXYZOctant", move);
    

        // Use the dictionary with the Export method
        using (var doc = RhinoDoc.CreateHeadless(null))
        {
            doc.Objects.AddMesh(mesh); // Add mesh to temporary document
            doc.Views.Redraw();

            bool success = doc.Export(fullPath, optionsDictionary); // Use the correct Export overload
            if (success)
            {
                A = "Successfully exported 3MF file to: " + fullPath;
            }
            else
            {
                A = "Failed to export 3MF file.";
            }
        }

    }
}
# ---------- end c_script_2 ----------
